# Dynamo graph script.dyn "BIM1_DeleteUnusedFilters" (Dynamo 2.0.2.6826)

# note: MONITORING
# note: BACKEND
# note: USER INTERFACE

# group: BIMOne
# note: DEPENDANCIES
# CODE
# note: EDITOR
# Jean-Marc Couffin - May 2019 - v1.1
# note: CREATOR
# Jean-Marc Couffin - July 2018 - v1.0
# Dynamo 2.0
# note: Copyright:
# This script is provided "as-is" under MIT License
# note: Created by BIMOne
# List and delete unused view filters and report in a window

# group: PACKAGE NAME
# note: Always name the specific package to facilitate debugging and deployment
# Exploding a package helps deployment to clients
# Example:
# Clockworks 1.5.5

# group: ACTION - DATA
# note: part of the script that affect data:
# Examples:
# ACTION - DATA - get parameter name from txt file

# group: MONITORING - description
# note: ckeck the integrity and consistency of data or geometry affected
# Examples:
# number of rooms matches number of parameters changed

# group: ACTION - GEOMETRY
# note: part of the script that affect  geometry:
# Examples:
# ACTION - GEOMETRY - translate geometry to new location

# group: UI
# note: User interface for the script: describe what the UI will do
# Example:
# UI - get shared parameter file path

# group: CONSTRAINT
# note: Fixed input that should not be set as inputs available through the dynamo player

# group: INPUT
# note: input by user that should be set as input for the dynamo player

# group: ACTION - DATA Check revit language
looks_up_for_some_french_to = Python()  # "Looks up for some french to design the interface"; unwired: IN[0]
# ---------- looks_up_for_some_french_to.python (16 lines) ----------
# BIM One Inc. - Jean-Marc Couffin - 2018

import clr
clr.AddReference('RevitServices')
from RevitServices.Persistence import DocumentManager

doc = DocumentManager.Instance.CurrentDBDocument

lang = str(doc.Application.Language)

if lang =="French":
	x = True
else:
	x = False
	
OUT = x
# ----------------------------------------

# group: Français
# note: INPUT
string = StringInput("Nombre de filtres inutilisés effacés: ")
string_2 = StringInput(" filtres effacés: ")
list_create = List.Create(item0=string, item1=string_2)

# group: English
string_3 = StringInput("# of deleted unused filters: ")
string_4 = StringInput(" deleted filters: ")
list_create_2 = List.Create(item0=string_3, item1=string_4)

if_ = If(test=looks_up_for_some_french_to, true=list_create, false=list_create_2)
code_block = CodeBlock(x=if_) { x[0]; x[1]; }

# group: ACTION - DATA Get the list of unused view filters
boolean = BoolSelector(true)  # graph input
get_unused_filters = Python(IN[0]=boolean)
# ---------- get_unused_filters.python (57 lines) ----------
import clr
clr.AddReference('ProtoGeometry')
from Autodesk.DesignScript.Geometry import *

clr.AddReference("System.Core")
import System.Linq
clr.ImportExtensions(System.Linq)

clr.AddReference("RevitAPI")
import Autodesk.Revit
from Autodesk.Revit.Exceptions import InvalidOperationException
from Autodesk.Revit.DB import *

# Import ToDSType(bool) extension method
clr.AddReference("RevitNodes")
import Revit
clr.ImportExtensions(Revit.Elements)

# Import DocumentManager
clr.AddReference("RevitServices")
import RevitServices
from RevitServices.Persistence import DocumentManager

def GetFilterIds(view):
  filterIds = None
  try:
    filterIds = view.GetFilters()
  except InvalidOperationException, e:
    filterIds = None
  return filterIds

def GetUsedFilterIds(doc):
  views = FilteredElementCollector(doc).OfClass(View).ToElements()
  usedFilterIds = []
  for view in views:
    viewFilterIds = []
    try:
      viewFilterIds = view.GetFilters()
    except InvalidOperationException, e:
      pass # this exception happens when a view doesn't support filters
    usedFilterIds.extend(viewFilterIds)
  return usedFilterIds

def GetUnusedFilters(doc):
  usedFilterIds = GetUsedFilterIds(doc).ToList[ElementId]()
  if len(usedFilterIds) > 0:
  	unusedFilters = FilteredElementCollector(doc).OfClass(ParameterFilterElement).Excluding(usedFilterIds).ToElements()
  else:
  	unusedFilters = FilteredElementCollector(doc).OfClass(ParameterFilterElement).ToElements()
  return list(f.ToDSType(True) for f in unusedFilters)

#The inputs to this node will be stored as a list in the IN variables.

doc = DocumentManager.Instance.CurrentDBDocument

#Assign your output to the OUT variable.
OUT = GetUnusedFilters(doc)
# ----------------------------------------
flatten = List.Flatten(list=get_unused_filters)

# group: ACTION - DATA List names of deleted unused filters
name = Element.Name(element=flatten)

transform_list_of_names_into = Python(IN[0]=name)  # "Transform list of names into strings paragraph"
# ---------- transform_list_of_names_into.python (1 lines) ----------
OUT = str('\n'.join(IN[0]))
# ----------------------------------------

# group: ACTION - DATA Wait to get the names of elements to be deleted before deletion
code_block_2 = CodeBlock(passthrough=flatten, waitfor=transform_list_of_names_into) { [passthrough,waitfor][0]; }

# group: ACTION - DATA Delete unused filters and count them
code_block_3 = CodeBlock { true; }
python_script = Python(IN[0]=code_block_2, IN[1]=code_block_3)
# ---------- python_script.python (35 lines) ----------
#Copyright(c) 2016, Dimitar Venkov
# @5devene, dimitar.ven@gmail.com

import clr

clr.AddReference("RevitServices")
import RevitServices
from RevitServices.Persistence import DocumentManager
from RevitServices.Transactions import TransactionManager
doc = DocumentManager.Instance.CurrentDBDocument

def tolist(obj1):
	if hasattr(obj1,"__iter__"): return obj1
	else: return [obj1]

elems = UnwrapElement(tolist(IN[0]) )

if IN[1]:
	deleted, failed = [], []
	TransactionManager.Instance.EnsureInTransaction(doc)
	for e in elems:
		id = None
		try:
			id = e.Id
			del_id = doc.Delete(id)
			deleted.extend([d.ToString() for d in del_id])
		except:
			if id is not None:
				failed.append(id.ToString() )
	TransactionManager.Instance.TransactionTaskDone()
	s = set(deleted)
	failed1 = [x for x in failed if x not in s]
	OUT = len(deleted)
else:
	OUT = "Set confirm to True", "", ""
# ----------------------------------------

# group: MONITORING Count how many were processed
python_script_2 = Python(IN[0]=code_block.out0, IN[1]=python_script, IN[2]=code_block.out1, IN[3]=transform_list_of_names_into)
# ---------- python_script_2.python (13 lines) ----------
# BIM One Inc. - Jean-Marc Couffin - 2019

import clr
clr.AddReference('RevitAPIUI')
from Autodesk.Revit.UI import TaskDialog


Title = IN[0]
TotalCount = str(IN[1])
Processed = IN[2]
Deleted = IN[3]

TaskDialog.Show( Title, TotalCount + ' ' + Processed + "\n" + "\n" + Deleted)
# ----------------------------------------
